% Simulink data dictionary dictionary_srf_pll.sldd

Configuration = Simulink.ConfigSet(StartTime="0", StopTime="3/5", FixedStep="tsample", Solver="FixedStepDiscrete", ProdHWDeviceType="Intel->x86-64 (Windows64)", SystemTargetFile="ert.tlc", TargetLang="C")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
A0 = fi(-1.597876, 1, 32, 30)
A1 = fi(0.622782, 1, 32, 31)
A3 = fi(2, 1, 32, 29)
A4 = fi(1.024906, 1, 32, 30)
B0 = fi(252, 1, 32, 23)
B1 = fi(-248, 1, 32, 23)
BW = 2010.619
NF_s = tf(num={[1 0 394784.2]}, den={[1 2010.619 394784.2]}, Ts=0)
NF_z = tf(num={[1 -1.999844 0.999999]}, den={[1 -1.960431 0.9605854]}, Ts=2.0e-5)
NF_z2 = tf(num={[1 -1.986146 0.9991316]}, den={[1 -1.655913 0.6688979]}, Ts=0.0002)
NFout = fi([0; 0; -0.118916; -0.1875961; -0.2218093; -0.2337465; -0.230598; -0.2164487; -0.1953963; -0.1710324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 0.0600626], 1, 32, 31)
PDout = fi([0; 0; -0.118916; -0.235415; -0.3450651; -0.4456541; -0.5346547; -0.6092157; -0.6680699; -0.7110399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 -0.1201171875], 1, 32, 31)
PIout = fi([0; 0; -29.96684; -47.74987; -57.12198; -61.0174; -61.15896; -58.51572; -54.07633; -48.7182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 81.30979], 1, 32, 24)
cos_th = fi([0; 0.99; 0.99; 0.9870018; 0.9813974; 0.9733091; 0.9627112; 0.9494845; 0.9334677; 0.914499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 -1], 1, 32, 31)
h_g_s = tf(num={[300 200]}, den={[1 0]}, Ts=0)
h_g_z = tf(num={[300.002 -299.998]}, den={[1 -1]}, Ts=2.0e-5)
h_g_z2 = tf(num={[300.02 -299.98]}, den={[1 -1]}, Ts=0.0002)
k = 751
kii = 200
kpp = 300
phase_th = fi([0; 0; 0.05683849; 0.1101204; 0.1615278; 0.2121562; 0.2627563; 0.313885; 0.3659016; 0.4189898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 3.162944], 1, 32, 29)
pi32 = fi(3.141593, 1, 32, 29)
q = 0.3125
sin_in = fi([0 -0.1201171875 -0.23779296875 -0.349609375 -0.4541015625 -0.54931640625 -0.6328125 -0.70361328125 -0.76171875 -0.806640625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 0], 1, 12, 11)
sin_th = fi([0; 0; 0.0562701; 0.1090192; 0.1597584; 0.209445; 0.2586945; 0.3079166; 0.3573056; 0.4068617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 0.02291333], 1, 32, 31)
t = [0 0.0002 0.0004 0.0006 0.0008 0.001 0.0012 0.0014 0.0016 0.0018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 0.15]
tsample = 0.0002
tsim = 0.15
wo = 628.3185
wout = fi(words=uint32([2339902448; 1]), 1, 35, 24)
ws = fi(314.1593, 1, 32, 22)
BusObject = Simulink.Bus(HeaderFile="fault")